# Grasshopper definition Logger_test.gh (Grasshopper 0.9.76)
# plug-ins: treesloth01, DesignLogger, Sift

number_slider = Slider(7.28, range=0..20)
number_slider_2 = Slider(5.82, range=0..20)
number_slider_3 = Slider(2.59, range=0..20)
run_session = BooleanToggle(False)
favorite = Button()
mm = MassMultiplication(Input=[number_slider, number_slider_2, number_slider_3])  # -> Result, PartialResults
ma = MassAddition(Input=[number_slider, number_slider_2, number_slider_3])  # -> Result, PartialResults
toggle = BooleanToggle(False)
end_session = Button()
panel = Panel(ma.Result)
dlog = DesignLogger(
    Start=run_session,
    ParticipantNumber="1234",
    SessionLength=Slider(30, range=0..100),
    LogPath="C:\Temp\Results.csv",
    Month=Slider(1, range=0..1),
    Day=Slider(1, range=0..1),
    Hour=Slider(11, range=0..12),
    DesignVector=[number_slider, number_slider_2, number_slider_3],
    ObjectiveVector=[ma.Result, mm.Result],
    Favorite=favorite,
    End=end_session)
sift = Sift(Variables=[number_slider, number_slider_2, number_slider_3], DesignMap=dlog, Index=Slider(3, range=0..4))  # disabled
clean = CleanTree(RemoveNulls=True, RemoveInvalid=True, RemoveEmpty=Toggle(True), Tree=dlog)
renumber = RenumberPaths(Data=clean)
panel_3 = Panel(renumber)
